# Dynamo graph BoqExportToXLS.dyn (Dynamo 2.16.1.2727)

string = StringInput("BoqExportToXLS.py")
file_from_path = FileObject(path=string)
readText = FileSystem.ReadText(file=file_from_path)
reload = BoolSelector(false)
python_script_from_string = PythonStringNode(script=readText, IN[0]=file_from_path, IN[1]=reload)  # CPython3
