# Dynamo graph CreateBoardByPreset.dyn (Dynamo 2.3.0.5885)

string = StringInput("CreateBoardByPreset.py")
file_from_path = FileObject(path=string)
readText = FileSystem.ReadText(file=file_from_path)
reload = BoolSelector(true)
select_board = DSModelElementSelection()  # nothing selected; graph input
presets = CodeBlock { "3A_sub"; "3B_sub"; "2E_main"; "2E_sub"; "2R_main"; "2R_sub"; }
list_create = List.Create(item0=presets.out0, item1=presets.out1, item2=presets.out2, item3=presets.out3, item4=presets.out4, item5=presets.out5)
integer_slider = IntegerSlider(0, range=0..100 step 1)  # graph input
getItemAtIndex = List.GetItemAtIndex(list=list_create, index=integer_slider)
python_script_from_string = PythonStringNode(script=readText, IN[0]=file_from_path, IN[1]=reload, IN[2]=select_board, IN[3]=getItemAtIndex)
