# Dynamo graph PrintPDF.dyn (Dynamo 2.16.1.2727)

string = StringInput("PrintPDF.py")  # graph input
file_from_path = FileObject(path=string)
readText = FileSystem.ReadText(file=file_from_path)

# group: Reload
# Reload
reload = BoolSelector(false)

# group: Printer settings
# Printer settings
printerDrivers = CodeBlock { "PDFCreator"; "PDF24"; }
printerDefaultPath = StringInput("C:\05 TEMP\PrintTest")  # graph input
printToPath = StringInput("C:\05 TEMP\PrintTest")  # graph input

# group: What to print!
# Input area
seq_number = IntegerSlider(763, range=0..5000 step 1)
getSheetsByListOfNumbers = CodeBlock()
# ---------- getSheetsByListOfNumbers.designscript (4 lines) ----------
[
"BER-GF-ZZZ-ZZ-XX-DR-G-TSLA-0XX-001",
"BER-GF-ZZZ-ZZ-XX-DR-G-TSLA-0XX-002"
];
# ----------------------------------------

python_script_from_string = PythonStringNode(script=readText, IN[0]=file_from_path, IN[1]=reload, IN[2]=printerDrivers.out0, IN[3]=printerDefaultPath, IN[4]=printToPath, IN[5]=seq_number)  # CPython3
