# Dynamo graph SimarisToRevit.dyn (Dynamo 2.13.1.3887)

string = StringInput("SimarisToRevit.py")  # graph input
file_from_path = FileObject(path=string)
readText = FileSystem.ReadText(file=file_from_path)

# group: Reload
# Reload
reload = BoolSelector(false)

# group: CSV
# csv database from Simaris
switch_settings = StringInput("CB1_switch_settings_lv_CB1-SUBN3_4.csv")  # graph input

python_script_from_string = PythonStringNode(script=readText, IN[0]=file_from_path, IN[1]=reload, IN[2]=switch_settings)  # CPython3
