# Dynamo graph SingleLineDiagramm.dyn (Dynamo 2.13.1.3887)

string = StringInput("SingleLineDiagramm.py")  # graph input
file_from_path = FileObject(path=string)
readText = FileSystem.ReadText(file=file_from_path)

# group: Reload
# Reload
reload = BoolSelector(true)

select_model_element = DSModelElementSelection()  # 1 picked in the model; graph input
string_2 = StringInput("test_4 Unnamed")
python_script_from_string = PythonStringNode(script=readText, IN[0]=file_from_path, IN[1]=reload, IN[2]=select_model_element, IN[3]=string_2)  # CPython3
