# Dynamo graph SystemInPanelSchedule.dyn (Dynamo 2.3.0.5885)

string = StringInput("SystemInPanelSchedule.py")  # graph input
file_from_path = FileObject(path=string)
readText = FileSystem.ReadText(file=file_from_path)
reload = BoolSelector(false)
string_2 = StringInput("CP1-SN3L1F03")
python_script_from_string = PythonStringNode(script=readText, IN[0]=file_from_path, IN[1]=reload, IN[2]=string_2)
